# Grasshopper definition Sample.gh (Grasshopper 1.0.7)
# plug-ins: ETC

planesrf = PlaneSurface(Plane=PlaneXY(0, 0, 0), XSize=Domain(-10, 10), YSize=Domain(-10, 10))
etc = MakeEvolutionTower(
    NFL=Slider(30, range=0..100),
    FloorHeight=Slider(3, range=0..10),
    Angle=Slider(0.1, range=0..1),
    R=Slider(0.4, range=0..1),
    Floor=planesrf)  # -> ETFloor, ETColumm
